# Dynamo graph 123.dyn (Dynamo 1.3.2.2480)

select_face = DSFaceSelection()  # 1 picked in the model
vertices = Face.Vertices(select_face)
flatten = Flatten(vertices)
pointGeometry = Vertex.PointGeometry(flatten)
select_model_element = DSModelElementSelection()  # 1 picked in the model
select_model_element_2 = DSModelElementSelection()  # 1 picked in the model
boundingBox = Geometry.BoundingBox(select_model_element_2)
maxPoint = BoundingBox.MaxPoint(boundingBox)
minPoint = BoundingBox.MinPoint(boundingBox)
create = List.Create(maxPoint, minPoint)
byPoints = PolyCurve.ByPoints(points=create)
boolean = BoolSelector(false)
createDefault = PathReinforcement.PathReinforcementType.CreateDefault()
rebar_bar_type = RebarBarType("10 A1000")
rebar_hook_type = RevitRebarHookType("None")
create_2 = PathReinforcement.Methods.Create(select_model_element, byPoints, boolean, createDefault, rebar_bar_type, rebar_hook_type, rebar_hook_type)
faces = Topology.Faces()  # unwired: arg0
