# Dynamo graph Home.dyn (Dynamo 1.3.2.2480)

cover = DoubleInput(-0.05)
bar_diameter = DoubleInput(0.025)
formula = Formula("a-(b/2)", a=cover, b=bar_diameter)
watch = Watch(formula)
select_face = DSFaceSelection()  # 1 picked in the model
offset = Surface.Offset(select_face, formula)
integer_slider = IntegerSlider(65, range=0..250 step 1)
code_block = CodeBlock(n=integer_slider) { 0..1..#2; 0..1..#n; }
pointAtParameter = Surface.PointAtParameter(surface=offset, u=code_block.out0, v=code_block.out0, lacing=CrossProduct)
number = DoubleInput(1)
flatten = List.Flatten(list=pointAtParameter, amt=number)
firstItem = List.FirstItem(flatten)
lastItem = List.LastItem(flatten)
byStartPointEndPoint = Line.ByStartPointEndPoint(startPoint=firstItem, endPoint=lastItem)
formula_2 = Formula("50*d", d=bar_diameter)
extendStart = Curve.ExtendStart(curve=byStartPointEndPoint, distance=formula_2)
select_model_element = DSModelElementSelection()  # 1 picked in the model
id = Element.Id(select_model_element)
rebar_style = RebarStyle("Standard")
rebar_bar_type = RebarBarType("10 A500")
rebar_hook_orientation = RebarHookOrientation("Left")
rebar_hook_type = RevitRebarHookType("None")
extendEnd = Curve.ExtendEnd(curve=extendStart, distance=cover)
normal = Curve.Normal(extendEnd)
byCurve = Rebar.ByCurve(extendStart, id, rebar_style, rebar_bar_type, arg5=rebar_hook_orientation, arg6=rebar_hook_type, arg7=rebar_hook_type, arg8=normal)  # unwired: arg4
watch_2 = Watch(select_model_element)
