# Dynamo graph Mega.dyn (Dynamo 1.3.2.2480)

select_walls_and_or_floors = DSModelElementsSelection()  # 2 picked in the model
ZAxis = Vector.ZAxis()
maximum_spacing_fixed_layout = BoolSelector(true)
major_rebar_bar_type = RebarBarType("10 A240")
major_number_of_rebar = IntegerSlider(9, range=0..100 step 1)
minor_rebar_bar_type = RebarBarType("10 A300")
# note: By setting this value to "False" Dynamo is binded with the generated reinforcement, which means you can do changes on the layout afterwards.
minor_number_of_rebar = IntegerSlider(10, range=0..100 step 1)
boolean = BoolSelector(false)
createFromHost = Custom[AreaReinforcement.CreateFromHost](HostElement=select_walls_and_or_floors@L2, MajorDirection=ZAxis, LayoutRule=maximum_spacing_fixed_layout, MajorBarType=major_rebar_bar_type, MajorNumberLines=major_number_of_rebar, MinorBarType=minor_rebar_bar_type, MinorNumberLines=minor_number_of_rebar, CreateNew=boolean)  # Create Area Reinforcement in a wall or floor according to the wall/floor sketch geometry. The exterior and interior reinforcement are the same by default.
