# Dynamo graph boka.dyn (Dynamo 1.3.2.2480)

select_model_element = DSModelElementSelection()  # 1 picked in the model
boundingBox = Geometry.BoundingBox(select_model_element)
maxPoint = BoundingBox.MaxPoint(boundingBox)
X = Vector.X(maxPoint)
minPoint = BoundingBox.MinPoint(boundingBox)
Y = Vector.Y(minPoint)
Z = Vector.Z(minPoint)
wallPoint2 = Point.ByCoordinates(x=X, y=Y, z=Z)
Z_2 = Vector.Z(maxPoint)
wallPoint3 = Point.ByCoordinates(x=X, y=Y, z=Z_2)
Y_2 = Vector.Y(maxPoint)
wallPoint6 = Point.ByCoordinates(x=X, y=Y_2, z=Z)
select_model_element_2 = DSModelElementSelection()  # 1 picked in the model
boundingBox_2 = Geometry.BoundingBox(select_model_element_2)
minPoint_2 = BoundingBox.MinPoint(boundingBox_2)
X_2 = Vector.X(minPoint_2)
Y_3 = Vector.Y(minPoint_2)
maxPoint_2 = BoundingBox.MaxPoint(boundingBox_2)
Z_3 = Vector.Z(maxPoint_2)
windowPoint0 = Point.ByCoordinates(x=X_2, y=Y_3, z=Z_3)
X_3 = Vector.X(maxPoint_2)
Y_4 = Vector.Y(maxPoint_2)
Z_4 = Vector.Z(minPoint_2)
windowPoint6 = Point.ByCoordinates(x=X_3, y=Y_4, z=Z_4)
X_4 = Vector.X(windowPoint6)
wallPoint20 = Point.ByCoordinates(x=X_4, y=Y_2, z=Z_2)
X_5 = Vector.X(minPoint)
windowPoint4 = Point.ByCoordinates(x=X_2, y=Y_4, z=Z_3)
Z_5 = Vector.Z(windowPoint4)
wallPoint22 = Point.ByCoordinates(x=X_5, y=Y_2, z=Z_5)
X_6 = Vector.X(windowPoint4)
wallPoint8 = Point.ByCoordinates(x=X_2, y=Y, z=Z)
windowPoint2 = Point.ByCoordinates(x=X_3, y=Y_3, z=Z_4)
X_7 = Vector.X(windowPoint2)
wallPoint9 = Point.ByCoordinates(x=X_7, y=Y, z=Z)
Z_6 = Vector.Z(windowPoint2)
wallPoint10 = Point.ByCoordinates(x=X, y=Y, z=Z_6)
windowPoint3 = Point.ByCoordinates(x=X_3, y=Y_3, z=Z_3)
Z_7 = Vector.Z(windowPoint3)
wallPoint11 = Point.ByCoordinates(x=X, y=Y, z=Z_7)
X_8 = Vector.X(windowPoint3)
wallPoint12 = Point.ByCoordinates(x=X_8, y=Y, z=Z_2)
Z_8 = Vector.Z(windowPoint4)
wallPoint14 = Point.ByCoordinates(x=X_5, y=Y, z=Z_8)
windowPoint5 = Point.ByCoordinates(x=X_2, y=Y_4, z=Z_4)
X_9 = Vector.X(windowPoint5)
wallPoint16 = Point.ByCoordinates(x=X_9, y=Y_2, z=Z)
wallPoint17 = Point.ByCoordinates(x=X_4, y=Y_2, z=Z)
Z_9 = Vector.Z(windowPoint6)
wallPoint18 = Point.ByCoordinates(x=X, y=Y_2, z=Z_9)
wallPoint19 = Point.ByCoordinates(x=X, y=Y_2, z=Z_3)
Z_10 = Vector.Z(windowPoint5)
wallPoint23 = Point.ByCoordinates(x=X_5, y=Y_2, z=Z_10)
Z_11 = Vector.Z(windowPoint5)
wallPoint15 = Point.ByCoordinates(x=X_5, y=Y, z=Z_11)
wallPoint0 = Point.ByCoordinates(x=X_5, y=Y, z=Z_2)
X_10 = Vector.X(wallPoint0)
wallPoint4 = Point.ByCoordinates(x=X_5, y=Y_2, z=Z_2)
Y_5 = Vector.Y(wallPoint4)
Y_6 = Vector.Y(wallPoint0)
mid_y = CodeBlock(x=Y_5, y=Y_6) { (x+y)/2; }
Z_12 = Vector.Z(wallPoint0)
byCoordinates = Point.ByCoordinates(x=X_10, y=mid_y, z=Z_12)
X_11 = Vector.X(minPoint)
Y_7 = Vector.Y(minPoint)
wallPoint5 = Point.ByCoordinates(x=X_5, y=Y_2, z=Z)
Y_8 = Vector.Y(wallPoint5)
mid_y_2 = CodeBlock(x=Y_7, y=Y_8) { (x+y)/2; }
Z_13 = Vector.Z(minPoint)
byCoordinates_2 = Point.ByCoordinates(x=X_11, y=mid_y_2, z=Z_13)
byStartPointEndPoint = Line.ByStartPointEndPoint(startPoint=byCoordinates, endPoint=byCoordinates_2)
boolean = BoolSelector(true)
create = List.Create(byCoordinates, wallPoint0, wallPoint4)
X_12 = Vector.X(windowPoint4)
wallPoint21 = Point.ByCoordinates(x=X_12, y=Y_2, z=Z_2)
X_13 = Vector.X(windowPoint4)
wallPoint13 = Point.ByCoordinates(x=X_13, y=Y, z=Z_2)
create_2 = List.Create(wallPoint21, wallPoint4, byCoordinates, wallPoint0, wallPoint13)
byPoints = PolyCurve.ByPoints(points=create_2)
basePlane = PolyCurve.BasePlane(byPoints)
normal = Plane.Normal(basePlane)
code_block = CodeBlock { 1; }
byControlPoints = NurbsCurve.ByControlPoints(create_2, code_block)
id = Element.Id(select_model_element)
rebar_style = RebarStyle("StirrupTie")
rebar_bar_type = RebarBarType("10 A300")
rebar_hook_orientation = RebarHookOrientation("Right")
rebar_hook_type = RevitRebarHookType("None")
asVector = Point.AsVector(create_2)
byCurve = Rebar.ByCurve(byControlPoints, id, rebar_style, rebar_bar_type, rebar_hook_orientation, rebar_hook_orientation, rebar_hook_type, rebar_hook_type, asVector)
