# Dynamo graph coords.dyn (Dynamo 1.3.2.2480)

select_model_element = DSModelElementSelection()
boundingBox = Geometry.BoundingBox(select_model_element)
minPoint = BoundingBox.MinPoint(boundingBox)
X = Vector.X(minPoint)
maxPoint = BoundingBox.MaxPoint(boundingBox)
Y = Vector.Y(maxPoint)
Z = Vector.Z(maxPoint)
windowPoint4 = Point.ByCoordinates(x=X, y=Y, z=Z)
X_2 = Vector.X(windowPoint4)
select_model_element_2 = DSModelElementSelection()
boundingBox_2 = Geometry.BoundingBox(select_model_element_2)
minPoint_2 = BoundingBox.MinPoint(boundingBox_2)
X_3 = Vector.X(minPoint_2)
Y_2 = Vector.Y(minPoint_2)
maxPoint_2 = BoundingBox.MaxPoint(boundingBox_2)
Z_2 = Vector.Z(maxPoint_2)
wallPoint0 = Point.ByCoordinates(x=X_3, y=Y_2, z=Z_2)
i_sector_reft_line = Line.ByStartPointEndPoint(startPoint=minPoint_2, endPoint=wallPoint0)
X_4 = Vector.X(windowPoint4)
wallPoint13 = Point.ByCoordinates(x=X_4, y=Y_2, z=Z_2)
Z_3 = Vector.Z(minPoint_2)
wallPoint8 = Point.ByCoordinates(x=X, y=Y_2, z=Z_3)
i_sector_right_line = Line.ByStartPointEndPoint(startPoint=wallPoint13, endPoint=wallPoint8)
create = List.Create(i_sector_reft_line, i_sector_right_line)
i_sector = Surface.ByLoft(create)
number_of_bars_i_section = DoubleSlider(5, range=5..100000 step 1)
desired_distance_between_bars = DoubleSlider(0, range=0..10000 step 0.1)  # "desired distance between bars (Section I)"
flip = BoolSelector(true)
offset_section_i = DoubleSlider(0, range=0..100 step 0.1)
idealize = BoolSelector(false)
include_first_edge_section_i = BoolSelector(true)
include_last_edge_section_i = BoolSelector(false)
followingSurface = DynamoRebar.Rebar.FollowingSurface(i_sector, number_of_bars_i_section, desired_distance_between_bars, flip, offset_section_i, idealize, include_first_edge_section_i, include_last_edge_section_i)
hostID = Element.Id(select_model_element_2)
rebarstyle_i_section = RebarStyle("Standard")
bar_type_i_section = RebarBarType("10 A240")
start_hook_orientation_i_section = RebarHookOrientation("Left")
end_hook_orientation_i_section = RebarHookOrientation("Left")
start_hook_type_i_section = RevitRebarHookType("None")
end_hook_type_i_section = RevitRebarHookType("None")
normal = Curve.Normal(followingSurface)
byCurve = Rebar.ByCurve(followingSurface, hostID, rebarstyle_i_section, bar_type_i_section, start_hook_orientation_i_section, end_hook_orientation_i_section, start_hook_type_i_section, end_hook_type_i_section, normal)
X_5 = Vector.X(maxPoint)
Y_3 = Vector.Y(minPoint)
Z_4 = Vector.Z(minPoint)
windowPoint2 = Point.ByCoordinates(x=X_5, y=Y_3, z=Z_4)
X_6 = Vector.X(windowPoint2)
wallPoint9 = Point.ByCoordinates(x=X_6, y=Y_2, z=Z_3)
windowPoint3 = Point.ByCoordinates(x=X_5, y=Y_3, z=Z)
X_7 = Vector.X(windowPoint3)
wallPoint12 = Point.ByCoordinates(x=X_7, y=Y_2, z=Z_2)
ii_sector_left_line = Line.ByStartPointEndPoint(startPoint=wallPoint9, endPoint=wallPoint12)
X_8 = Vector.X(maxPoint_2)
wallPoint2 = Point.ByCoordinates(x=X_8, y=Y_2, z=Z_3)
wallPoint3 = Point.ByCoordinates(x=X_8, y=Y_2, z=Z_2)
ii_sector_left_line_2 = Line.ByStartPointEndPoint(startPoint=wallPoint2, endPoint=wallPoint3)
create_2 = List.Create(ii_sector_left_line, ii_sector_left_line_2)
ii_sector = Surface.ByLoft(create_2)
number_of_bars_ii_section = DoubleSlider(5, range=5..100000 step 1)
desired_distance_between_bars_2 = DoubleSlider(0, range=0..10000 step 0.1)  # "desired distance between bars (Section II)"
flip_2 = BoolSelector(true)
offset_section_ii = DoubleSlider(0, range=0..100 step 0.1)
idealize_2 = BoolSelector(false)
include_first_edge_section_ii = BoolSelector(false)
include_last_edge_section_ii = BoolSelector(true)
followingSurface_2 = DynamoRebar.Rebar.FollowingSurface(ii_sector, number_of_bars_ii_section, desired_distance_between_bars_2, flip_2, offset_section_ii, idealize_2, include_first_edge_section_ii, include_last_edge_section_ii)
rebarstyle_ii_section = RebarStyle("Standard")
bar_type_ii_section = RebarBarType("10 A240")
start_hook_orientation_ii = RebarHookOrientation("Left")  # "Start Hook Orientation(II Section)"
end_hook_orientation_ii_section = RebarHookOrientation("Left")
start_hook_type_ii_section = RevitRebarHookType("None")
end_hook_type_ii_section = RevitRebarHookType("None")
normal_2 = Curve.Normal(followingSurface_2)
byCurve_2 = Rebar.ByCurve(followingSurface_2, hostID, rebarstyle_ii_section, bar_type_ii_section, start_hook_orientation_ii, end_hook_orientation_ii_section, start_hook_type_ii_section, end_hook_type_ii_section, normal_2)
Y_4 = Vector.Y(maxPoint_2)
wallPoint4 = Point.ByCoordinates(x=X_3, y=Y_4, z=Z_2)
wallPoint5 = Point.ByCoordinates(x=X_3, y=Y_4, z=Z_3)
iii_sector_left_line = Line.ByStartPointEndPoint(startPoint=wallPoint4, endPoint=wallPoint5)
windowPoint5 = Point.ByCoordinates(x=X, y=Y, z=Z_4)
X_9 = Vector.X(windowPoint5)
wallPoint16 = Point.ByCoordinates(x=X_9, y=Y_4, z=Z_3)
X_10 = Vector.X(windowPoint4)
wallPoint21 = Point.ByCoordinates(x=X_10, y=Y_4, z=Z_2)
iii_sector_right_line = Line.ByStartPointEndPoint(startPoint=wallPoint16, endPoint=wallPoint21)
create_3 = List.Create(iii_sector_left_line, iii_sector_right_line)
iii_sector = Surface.ByLoft(create_3)
number_of_bars_iii_section = DoubleSlider(5, range=5..100000 step 1)
desired_distance_between_bars_3 = DoubleSlider(0, range=0..10000 step 0.1)  # "desired distance between bars (Section III)"
flip_3 = BoolSelector(true)
offset_section_iii = DoubleSlider(0, range=0..100 step 0.1)
idealize_3 = BoolSelector(false)
include_first_edge_section_iii = BoolSelector(true)
include_last_edge_section_iii = BoolSelector(false)
followingSurface_3 = DynamoRebar.Rebar.FollowingSurface(iii_sector, number_of_bars_iii_section, desired_distance_between_bars_3, flip_3, offset_section_iii, idealize_3, include_first_edge_section_iii, include_last_edge_section_iii)
rebar_style_section_iii = RebarStyle("Standard")
bar_type_iii_section = RebarBarType("10 A1000")
starthookorientation_section_iii = RebarHookOrientation("Left")
endhookorientation_section_iii = RebarHookOrientation("Right")
start_hook_type_iii_section = RevitRebarHookType("None")
end_hook_type_iii_section = RevitRebarHookType("None")
normal_3 = Curve.Normal(followingSurface_3)
byCurve_3 = Rebar.ByCurve(followingSurface_3, hostID, rebar_style_section_iii, bar_type_iii_section, starthookorientation_section_iii, endhookorientation_section_iii, start_hook_type_iii_section, end_hook_type_iii_section, normal_3)
wallPoint6 = Point.ByCoordinates(x=X_8, y=Y_4, z=Z_3)
iv_sector_left_line = Line.ByStartPointEndPoint(startPoint=wallPoint6, endPoint=maxPoint_2)
windowPoint6 = Point.ByCoordinates(x=X_5, y=Y, z=Z_4)
X_11 = Vector.X(windowPoint6)
wallPoint17 = Point.ByCoordinates(x=X_11, y=Y_4, z=Z_3)
wallPoint20 = Point.ByCoordinates(x=X_11, y=Y_4, z=Z_2)
iv_sector_right_line = Line.ByStartPointEndPoint(startPoint=wallPoint17, endPoint=wallPoint20)
create_4 = List.Create(iv_sector_left_line, iv_sector_right_line)
iv_sector = Surface.ByLoft(create_4)
number_of_bars_iv_section = DoubleSlider(5, range=5..100000 step 1)
desired_distance_between_bars_iv = DoubleSlider(0, range=0..10000 step 0.1)  # "desired distance between bars (IV Section)"
flip_4 = BoolSelector(true)
offset_iv_section = DoubleSlider(0, range=0..100 step 0.1)
idealize_4 = BoolSelector(false)
include_first_edge_iv_section = BoolSelector(true)
include_last_edge_iv_section = BoolSelector(false)
followingSurface_4 = DynamoRebar.Rebar.FollowingSurface(iv_sector, number_of_bars_iv_section, desired_distance_between_bars_iv, flip_4, offset_iv_section, idealize_4, include_first_edge_iv_section, include_last_edge_iv_section)
rebarstyle_iv_section = RebarStyle("Standard")
bar_type_iv_section = RebarBarType("10 A1000")
start_hook_orientation_iv = RebarHookOrientation("Right")  # "Start Hook Orientation(IV Section)"
end_hook_orientation_iv_section = RebarHookOrientation("Left")
start_hook_type_iv_section = RevitRebarHookType("None")
end_hook_type_iv_section = RevitRebarHookType("None")
normal_4 = Curve.Normal(followingSurface_4)
byCurve_4 = Rebar.ByCurve(followingSurface_4, hostID, rebarstyle_iv_section, bar_type_iv_section, start_hook_orientation_iv, end_hook_orientation_iv_section, start_hook_type_iv_section, end_hook_type_iv_section, normal_4)
v_sector_upper_line = Line.ByStartPointEndPoint(startPoint=wallPoint0, endPoint=wallPoint3)
Z_5 = Vector.Z(windowPoint4)
wallPoint14 = Point.ByCoordinates(x=X_3, y=Y_2, z=Z_5)
Z_6 = Vector.Z(windowPoint3)
wallPoint11 = Point.ByCoordinates(x=X_8, y=Y_2, z=Z_6)
v_sector_bottom_line = Line.ByStartPointEndPoint(startPoint=wallPoint14, endPoint=wallPoint11)
create_5 = List.Create(v_sector_upper_line, v_sector_bottom_line)
v_sector = Surface.ByLoft(create_5)
number_of_bars_v_section = DoubleSlider(5, range=5..100000 step 1)
desired_distance_between_bars_v = DoubleSlider(0, range=0..10000 step 0.1)  # "desired distance between bars (V Section)"
flip_5 = BoolSelector(true)
offset_v_section = DoubleSlider(0, range=0..100 step 0.1)
idealize_5 = BoolSelector(false)
include_first_edge_v_section = BoolSelector(true)
include_last_edge_v_section = BoolSelector(false)
followingSurface_5 = DynamoRebar.Rebar.FollowingSurface(v_sector, number_of_bars_v_section, desired_distance_between_bars_v, flip_5, offset_v_section, idealize_5, include_first_edge_v_section, include_last_edge_v_section)
rebarstyle_v_section = RebarStyle("Standard")
bar_type_v_section = RebarBarType("10 A300")
start_hook_orientation_v_section = RebarHookOrientation("Right")
end_hook_orientation_v_section = RebarHookOrientation("Right")
start_hook_type_v_section = RevitRebarHookType("None")
end_hook_type_v_section = RevitRebarHookType("None")
normal_5 = Curve.Normal(followingSurface_5)
byCurve_5 = Rebar.ByCurve(followingSurface_5, hostID, rebarstyle_v_section, bar_type_v_section, start_hook_orientation_v_section, end_hook_orientation_v_section, start_hook_type_v_section, end_hook_type_v_section, normal_5)
vi_sector_upper_line = Line.ByStartPointEndPoint(startPoint=minPoint_2, endPoint=wallPoint2)
Z_7 = Vector.Z(windowPoint5)
wallPoint15 = Point.ByCoordinates(x=X_3, y=Y_2, z=Z_7)
Z_8 = Vector.Z(windowPoint2)
wallPoint10 = Point.ByCoordinates(x=X_8, y=Y_2, z=Z_8)
vi_sector_bottom_line = Line.ByStartPointEndPoint(startPoint=wallPoint15, endPoint=wallPoint10)
create_6 = List.Create(vi_sector_upper_line, vi_sector_bottom_line)
vi_sector = Surface.ByLoft(create_6)
number_of_bars_vi_section = DoubleSlider(5, range=5..100000 step 1)
desired_distance_between_bars_vi = DoubleSlider(0, range=0..10000 step 0.1)  # "desired distance between bars (VI Section)"
flip_6 = BoolSelector(true)
offset_vi_section = DoubleSlider(0, range=0..100 step 0.1)
idealize_6 = BoolSelector(false)
include_first_edge_vi_section = BoolSelector(true)
include_last_edge_vi_section = BoolSelector(false)
followingSurface_6 = DynamoRebar.Rebar.FollowingSurface(vi_sector, number_of_bars_vi_section, desired_distance_between_bars_vi, flip_6, offset_vi_section, idealize_6, include_first_edge_vi_section, include_last_edge_vi_section)
rebar_style = RebarStyle("Standard")
bar_type_vi_section = RebarBarType("10 A1000")
start_hook_orientation = RebarHookOrientation("Left")
end_hook_orientation_section_vi = RebarHookOrientation("Left")
start_hook_type_vi_section = RevitRebarHookType("None")
end_hook_type_vi_section = RevitRebarHookType("None")
normal_6 = Curve.Normal(followingSurface_6)
byCurve_6 = Rebar.ByCurve(followingSurface_6, hostID, rebar_style, bar_type_vi_section, start_hook_orientation, end_hook_orientation_section_vi, start_hook_type_vi_section, end_hook_type_vi_section, normal_6)
vii_sector_upper_line = Line.ByStartPointEndPoint(startPoint=wallPoint6, endPoint=wallPoint5)
Z_9 = Vector.Z(windowPoint6)
wallPoint18 = Point.ByCoordinates(x=X_8, y=Y_4, z=Z_9)
Z_10 = Vector.Z(windowPoint5)
wallPoint23 = Point.ByCoordinates(x=X_3, y=Y_4, z=Z_10)
vii_sector_bottom_line = Line.ByStartPointEndPoint(startPoint=wallPoint18, endPoint=wallPoint23)
create_7 = List.Create(vii_sector_upper_line, vii_sector_bottom_line)
vii_sector = Surface.ByLoft(create_7)
number_of_bars_vi_section_2 = DoubleSlider(5, range=5..100000 step 1)
desired_distance_between_bars_vi_2 = DoubleSlider(0, range=0..10000 step 0.1)  # "desired distance between bars (VI Section)"
flip_7 = BoolSelector(true)
offset_vi_section_2 = DoubleSlider(0, range=0..100 step 0.1)
idealize_7 = BoolSelector(false)
include_first_edge_vi_section_2 = BoolSelector(true)
include_last_edge_vi_section_2 = BoolSelector(false)
followingSurface_7 = DynamoRebar.Rebar.FollowingSurface(vii_sector, number_of_bars_vi_section_2, desired_distance_between_bars_vi_2, flip_7, offset_vi_section_2, idealize_7, include_first_edge_vi_section_2, include_last_edge_vi_section_2)
rebar_style_2 = RebarStyle("Standard")
bar_type_vi_section_2 = RebarBarType("10 A1000")
start_hook_orientation_2 = RebarHookOrientation("Right")
end_hook_orientation = RebarHookOrientation("Right")
start_hook_type_v_section_2 = RevitRebarHookType("None")
end_hook_type_vi_section_2 = RevitRebarHookType("None")
normal_7 = Curve.Normal(followingSurface_7)
byCurve_7 = Rebar.ByCurve(followingSurface_7, hostID, rebar_style_2, bar_type_vi_section_2, start_hook_orientation_2, end_hook_orientation, start_hook_type_v_section_2, end_hook_type_vi_section_2, normal_7)
viii_sector_upper_line = Line.ByStartPointEndPoint(startPoint=wallPoint4, endPoint=maxPoint_2)
wallPoint19 = Point.ByCoordinates(x=X_8, y=Y_4, z=Z)
Z_11 = Vector.Z(windowPoint4)
wallPoint22 = Point.ByCoordinates(x=X_3, y=Y_4, z=Z_11)
viii_sector_bottom_line = Line.ByStartPointEndPoint(startPoint=wallPoint19, endPoint=wallPoint22)
create_8 = List.Create(viii_sector_upper_line, viii_sector_bottom_line)
viii_sector = Surface.ByLoft(create_8)
number_of_bars_vii_section = DoubleSlider(5, range=5..100000 step 1)
desired_distance_between_bars_4 = DoubleSlider(0, range=0..10000 step 0.1)  # "desired distance between bars (VII Section)"
flip_8 = BoolSelector(true)
offset_vii_section = DoubleSlider(0, range=0..100 step 0.1)
idealize_8 = BoolSelector(false)
include_first_edge_vii_section = BoolSelector(true)
include_last_edge_vii_section = BoolSelector(false)
followingSurface_8 = DynamoRebar.Rebar.FollowingSurface(viii_sector, number_of_bars_vii_section, desired_distance_between_bars_4, flip_8, offset_vii_section, idealize_8, include_first_edge_vii_section, include_last_edge_vii_section)
rebar_style_3 = RebarStyle("Standard")
bar_type_vii_section = RebarBarType("10 A1000")
start_hook_orientation_vii = RebarHookOrientation("Left")  # "Start Hook Orientation ( VII Section)"
end_hook_orientation_section_vii = RebarHookOrientation("Left")
start_hook_type_vii_section = RevitRebarHookType("None")
end_hook_type_vii_section = RevitRebarHookType("None")
normal_8 = Curve.Normal(followingSurface_8)
byCurve_8 = Rebar.ByCurve(followingSurface_8, hostID, rebar_style_3, bar_type_vii_section, start_hook_orientation_vii, end_hook_orientation_section_vii, start_hook_type_vii_section, end_hook_type_vii_section, normal_8)
windowPoint0 = Point.ByCoordinates(x=X, y=Y_3, z=Z)
x_sector_upper_line = Line.ByStartPointEndPoint(startPoint=windowPoint0, endPoint=windowPoint3)
x_sector_bottom_line = Line.ByStartPointEndPoint(startPoint=wallPoint12, endPoint=wallPoint13)
create_9 = List.Create(x_sector_upper_line, x_sector_bottom_line)
x_sector = Surface.ByLoft(create_9)
number_of_bars_ix_section = DoubleSlider(5, range=5..100000 step 1)
desired_distance_between_bars_5 = DoubleSlider(0, range=0..10000 step 0.1)  # "desired distance between bars (Section IX)"
flip_9 = BoolSelector(false)
offset_section_ix = DoubleSlider(0, range=0..100 step 0.1)
idealize_9 = BoolSelector(false)
include_first_edge_section_ix = BoolSelector(true)
include_last_edge_section_ix = BoolSelector(true)
followingSurface_9 = DynamoRebar.Rebar.FollowingSurface(x_sector, number_of_bars_ix_section, desired_distance_between_bars_5, flip_9, offset_section_ix, idealize_9, include_first_edge_section_ix, include_last_edge_section_ix)
rebar_style_section_ix = RebarStyle("Standard")
bar_type_ix_section = RebarBarType("10 A1000")
start_hook_orientation_section = RebarHookOrientation("Right")  # "Start Hook Orientation (Section IX)"
end_hook_orientation_section_ix = RebarHookOrientation("Left")
start_hook_type_ix_section = RevitRebarHookType("None")
end_hook_type_ix_section = RevitRebarHookType("None")
normal_9 = Curve.Normal(followingSurface_9)
byCurve_9 = Rebar.ByCurve(followingSurface_9, hostID, rebar_style_section_ix, bar_type_ix_section, start_hook_orientation_section, end_hook_orientation_section_ix, start_hook_type_ix_section, end_hook_type_ix_section, normal_9)
x_sector_upper_line_2 = Line.ByStartPointEndPoint(startPoint=wallPoint8, endPoint=wallPoint9)
x_sector_bottom_line_2 = Line.ByStartPointEndPoint(startPoint=minPoint, endPoint=windowPoint2)
create_10 = List.Create(x_sector_upper_line_2, x_sector_bottom_line_2)
x_sector_2 = Surface.ByLoft(create_10)
number_of_bars_ix_section_2 = DoubleSlider(5, range=5..100000 step 1)
desired_distance_between_bars_6 = DoubleSlider(0, range=0..10000 step 0.1)  # "desired distance between bars (Section IX)"
flip_10 = BoolSelector(false)
offset_section_ix_2 = DoubleSlider(0, range=0..100 step 0.1)
idealize_10 = BoolSelector(false)
include_first_edge_section_ix_2 = BoolSelector(true)
include_last_edge_section_ix_2 = BoolSelector(true)
followingSurface_10 = DynamoRebar.Rebar.FollowingSurface(x_sector_2, number_of_bars_ix_section_2, desired_distance_between_bars_6, flip_10, offset_section_ix_2, idealize_10, include_first_edge_section_ix_2, include_last_edge_section_ix_2)
rebar_style_x_section = RebarStyle("Standard")
bar_type_ix_section_2 = RebarBarType("10 A300")
start_hook_orientation_x_section = RebarHookOrientation("Right")
end_hook_orientation_x_section = RebarHookOrientation("Left")
start_hook_type_ix_section_2 = RevitRebarHookType("None")
end_hook_type_ix_section_2 = RevitRebarHookType("None")
normal_10 = Curve.Normal(followingSurface_10)
byCurve_10 = Rebar.ByCurve(followingSurface_10, hostID, rebar_style_x_section, bar_type_ix_section_2, start_hook_orientation_x_section, end_hook_orientation_x_section, start_hook_type_ix_section_2, end_hook_type_ix_section_2, normal_10)
xi_sector_upper_line = Line.ByStartPointEndPoint(startPoint=wallPoint14, endPoint=wallPoint15)
xi_sector_bottom_line = Line.ByStartPointEndPoint(startPoint=windowPoint0, endPoint=minPoint)
create_11 = List.Create(xi_sector_upper_line, xi_sector_bottom_line)
xi_sector = Surface.ByLoft(create_11)
number_of_bars_ix_section_3 = DoubleSlider(5, range=5..100000 step 1)
desired_distance_between_bars_7 = DoubleSlider(0, range=0..10000 step 0.1)  # "desired distance between bars (Section IX)"
flip_11 = BoolSelector(false)
offset_section_ix_3 = DoubleSlider(0, range=0..100 step 0.1)
idealize_11 = BoolSelector(false)
include_first_edge_section_ix_3 = BoolSelector(true)
include_last_edge_section_ix_3 = BoolSelector(true)
followingSurface_11 = DynamoRebar.Rebar.FollowingSurface(xi_sector, number_of_bars_ix_section_3, desired_distance_between_bars_7, flip_11, offset_section_ix_3, idealize_11, include_first_edge_section_ix_3, include_last_edge_section_ix_3)
rebar_style_4 = RebarStyle("Standard")
bar_type_ix_section_3 = RebarBarType("10 A240")
sart_hook_orientation_ix_section = RebarHookOrientation("Left")
end_hook_orientation_ix_section = RebarHookOrientation("Left")
start_hook_type_ix_section_3 = RevitRebarHookType("None")
end_hook_type_ix_section_3 = RevitRebarHookType("None")
normal_11 = Curve.Normal(followingSurface_11)
byCurve_11 = Rebar.ByCurve(followingSurface_11, hostID, rebar_style_4, bar_type_ix_section_3, sart_hook_orientation_ix_section, end_hook_orientation_ix_section, start_hook_type_ix_section_3, end_hook_type_ix_section_3, normal_11)
xii_sector_upper_line = Line.ByStartPointEndPoint(startPoint=windowPoint2, endPoint=windowPoint3)
xii_sector_bottom_line = Line.ByStartPointEndPoint(startPoint=wallPoint10, endPoint=wallPoint11)
create_12 = List.Create(xii_sector_upper_line, xii_sector_bottom_line)
xii_sector = Surface.ByLoft(create_12)
number_of_bars_ix_section_4 = DoubleSlider(5, range=5..100000 step 1)
desired_distance_between_bars_8 = DoubleSlider(0, range=0..10000 step 0.1)  # "desired distance between bars (Section IX)"
flip_12 = BoolSelector(false)
offset_section_ix_4 = DoubleSlider(0, range=0..100 step 0.1)
idealize_12 = BoolSelector(false)
include_first_edge_section_ix_4 = BoolSelector(true)
include_last_edge_section_ix_4 = BoolSelector(true)
followingSurface_12 = DynamoRebar.Rebar.FollowingSurface(xii_sector, number_of_bars_ix_section_4, desired_distance_between_bars_8, flip_12, offset_section_ix_4, idealize_12, include_first_edge_section_ix_4, include_last_edge_section_ix_4)
rebar_style_xii_section = RebarStyle("Standard")
bar_type_ix_section_4 = RebarBarType("10 A240")
start_hook_orientationn_section = RebarHookOrientation("Left")  # "Start Hook Orientationn ( Section XII)"
end_hook_orientation_xii_section = RebarHookOrientation("Left")
start_hook_type_ix_section_4 = RevitRebarHookType("None")
end_hook_type_ix_section_4 = RevitRebarHookType("None")
normal_12 = Curve.Normal(followingSurface_12)
byCurve_12 = Rebar.ByCurve(followingSurface_12, hostID, rebar_style_xii_section, bar_type_ix_section_4, start_hook_orientationn_section, end_hook_orientation_xii_section, start_hook_type_ix_section_4, end_hook_type_ix_section_4, normal_12)
xiii_sector_upper_line = Line.ByStartPointEndPoint(startPoint=windowPoint4, endPoint=maxPoint)
xiii_sector_bottom_line = Line.ByStartPointEndPoint(startPoint=wallPoint20, endPoint=wallPoint21)
create_13 = List.Create(xiii_sector_upper_line, xiii_sector_bottom_line)
xiii_sector = Surface.ByLoft(create_13)
number_of_bars_ix_section_5 = DoubleSlider(5, range=5..100000 step 1)
desired_distance_between_bars_9 = DoubleSlider(0, range=0..10000 step 0.1)  # "desired distance between bars (Section IX)"
flip_13 = BoolSelector(false)
offset_section_ix_5 = DoubleSlider(0, range=0..100 step 0.1)
idealize_13 = BoolSelector(false)
include_first_edge_section_ix_5 = BoolSelector(true)
include_last_edge_section_ix_5 = BoolSelector(true)
followingSurface_13 = DynamoRebar.Rebar.FollowingSurface(xiii_sector, number_of_bars_ix_section_5, desired_distance_between_bars_9, flip_13, offset_section_ix_5, idealize_13, include_first_edge_section_ix_5, include_last_edge_section_ix_5)
rebar_style_5 = RebarStyle("Standard")
bar_type_ix_section_5 = RebarBarType("10 A1000")
end_hook_orientation_ix_section_2 = RebarHookOrientation("Left")
end_hook_orientation_ix_section_3 = RebarHookOrientation("Left")
start_hook_type_ix_section_5 = RevitRebarHookType("None")
end_hook_type_ix_section_5 = RevitRebarHookType("None")
normal_13 = Curve.Normal(followingSurface_13)
byCurve_13 = Rebar.ByCurve(followingSurface_13, hostID, rebar_style_5, bar_type_ix_section_5, end_hook_orientation_ix_section_2, end_hook_orientation_ix_section_3, start_hook_type_ix_section_5, end_hook_type_ix_section_5, normal_13)
xiv_sector_upper_line = Line.ByStartPointEndPoint(startPoint=windowPoint5, endPoint=windowPoint6)
xiv_sector_bottom_line = Line.ByStartPointEndPoint(startPoint=wallPoint16, endPoint=wallPoint17)
create_14 = List.Create(xiv_sector_upper_line, xiv_sector_bottom_line)
xiv_sector = Surface.ByLoft(create_14)
number_of_bars_ix_section_6 = DoubleSlider(5, range=5..100000 step 1)
desired_distance_between_bars_10 = DoubleSlider(0, range=0..10000 step 0.1)  # "desired distance between bars (Section IX)"
flip_14 = BoolSelector(false)
offset_section_ix_6 = DoubleSlider(0, range=0..100 step 0.1)
idealize_14 = BoolSelector(false)
include_first_edge_section_ix_6 = BoolSelector(true)
include_last_edge_section_ix_6 = BoolSelector(true)
followingSurface_14 = DynamoRebar.Rebar.FollowingSurface(xiv_sector, number_of_bars_ix_section_6, desired_distance_between_bars_10, flip_14, offset_section_ix_6, idealize_14, include_first_edge_section_ix_6, include_last_edge_section_ix_6)
rebar_style_section_xiv = RebarStyle("Standard")
bar_type_ix_section_6 = RebarBarType("10 A240")
start_hook_orientation_xiv = RebarHookOrientation("Left")  # "Start Hook Orientation(XIV Sector)"
end_hook_orientation_xiv_sector = RebarHookOrientation("Left")
start_hook_type_ix_section_6 = RevitRebarHookType("None")
end_hook_type_ix_section_6 = RevitRebarHookType("None")
normal_14 = Curve.Normal(followingSurface_14)
byCurve_14 = Rebar.ByCurve(followingSurface_14, hostID, rebar_style_section_xiv, bar_type_ix_section_6, start_hook_orientation_xiv, end_hook_orientation_xiv_sector, start_hook_type_ix_section_6, end_hook_type_ix_section_6, normal_14)
xv_sector_upper_line = Line.ByStartPointEndPoint(startPoint=windowPoint6, endPoint=maxPoint)
xv_sector_bottom_line = Line.ByStartPointEndPoint(startPoint=wallPoint18, endPoint=wallPoint19)
create_15 = List.Create(xv_sector_upper_line, xv_sector_bottom_line)
xv_sector = Surface.ByLoft(create_15)
number_of_bars_ix_section_7 = DoubleSlider(5, range=5..100000 step 1)
desired_distance_between_bars_11 = DoubleSlider(0, range=0..10000 step 0.1)  # "desired distance between bars (Section IX)"
flip_15 = BoolSelector(false)
offset_section_ix_7 = DoubleSlider(0, range=0..100 step 0.1)
idealize_15 = BoolSelector(false)
include_first_edge_section_ix_7 = BoolSelector(true)
include_last_edge_section_ix_7 = BoolSelector(true)
followingSurface_15 = DynamoRebar.Rebar.FollowingSurface(xv_sector, number_of_bars_ix_section_7, desired_distance_between_bars_11, flip_15, offset_section_ix_7, idealize_15, include_first_edge_section_ix_7, include_last_edge_section_ix_7)
rebar_style_6 = RebarStyle("Standard")
bar_type_ix_section_7 = RebarBarType("10 A240")
start_hook_orientation_ix = RebarHookOrientation("Left")  # "Start Hook Orientation (IX Section)"
end_hook_orientation_ix_section_4 = RebarHookOrientation("Left")
start_hook_type_ix_section_7 = RevitRebarHookType("None")
end_hook_type_ix_section_7 = RevitRebarHookType("None")
normal_15 = Curve.Normal(followingSurface_15)
byCurve_15 = Rebar.ByCurve(followingSurface_15, hostID, rebar_style_6, bar_type_ix_section_7, start_hook_orientation_ix, end_hook_orientation_ix_section_4, start_hook_type_ix_section_7, end_hook_type_ix_section_7, normal_15)
xv_sector_upper_line_2 = Line.ByStartPointEndPoint(startPoint=windowPoint4, endPoint=windowPoint5)
xv_sector_bottom_line_2 = Line.ByStartPointEndPoint(startPoint=wallPoint22, endPoint=wallPoint23)
create_16 = List.Create(xv_sector_upper_line_2, xv_sector_bottom_line_2)
xv_sector_2 = Surface.ByLoft(create_16)
number_of_bars_ix_section_8 = DoubleSlider(5, range=5..100000 step 1)
desired_distance_between_bars_12 = DoubleSlider(0, range=0..10000 step 0.1)  # "desired distance between bars (Section IX)"
flip_16 = BoolSelector(false)
offset_section_ix_8 = DoubleSlider(0, range=0..100 step 0.1)
idealize_16 = BoolSelector(false)
include_first_edge_section_ix_8 = BoolSelector(true)
include_last_edge_section_ix_8 = BoolSelector(true)
followingSurface_16 = DynamoRebar.Rebar.FollowingSurface(xv_sector_2, number_of_bars_ix_section_8, desired_distance_between_bars_12, flip_16, offset_section_ix_8, idealize_16, include_first_edge_section_ix_8, include_last_edge_section_ix_8)
rebar_style_xv_section = RebarStyle("Standard")
bar_type_ix_section_8 = RebarBarType("10 A240")
start_hook_orientation_xv = RebarHookOrientation("Right")  # "Start Hook Orientation (XV Section)"
end_hook_orientation_xv_section = RebarHookOrientation("Left")
start_hook_type_ix_section_8 = RevitRebarHookType("None")
end_hook_type_ix_section_8 = RevitRebarHookType("None")
normal_16 = Curve.Normal(followingSurface_16)
byCurve_16 = Rebar.ByCurve(followingSurface_16, hostID, rebar_style_xv_section, bar_type_ix_section_8, start_hook_orientation_xv, end_hook_orientation_xv_section, start_hook_type_ix_section_8, end_hook_type_ix_section_8, normal_16)
X_12 = Vector.X()  # unwired: arg0
Y_5 = Vector.Y()  # unwired: arg0
Y_6 = Vector.Y()  # unwired: arg0
mid_y = CodeBlock(x=Y_5, y=Y_6) { (x+y)/2; }
Z_12 = Vector.Z()  # unwired: arg0
byCoordinates = Point.ByCoordinates(x=X_12, y=mid_y, z=Z_12)
X_13 = Vector.X()  # unwired: arg0
Y_7 = Vector.Y()  # unwired: arg0
Y_8 = Vector.Y()  # unwired: arg0
mid_y_2 = CodeBlock(x=Y_7, y=Y_8) { (x+y)/2; }
Z_13 = Vector.Z()  # unwired: arg0
byCoordinates_2 = Point.ByCoordinates(x=X_13, y=mid_y_2, z=Z_13)
byStartPointEndPoint = Line.ByStartPointEndPoint(startPoint=byCoordinates, endPoint=byCoordinates_2)
boolean = BoolSelector(true)
create_17 = List.Create(byCoordinates)  # unwired: arg1, arg2
select_model_elements = DSModelElementsSelection()  # frozen
curves = Element.Curves(select_model_elements)
flatten = Flatten(curves)
byJoinedCurves = PolyCurve.ByJoinedCurves(flatten)
select_model_element_3 = DSModelElementSelection()
id = Element.Id(select_model_element_3)
rebar_style_7 = RebarStyle()
rebar_bar_type = RebarBarType()
rebar_hook_orientation = RebarHookOrientation()
rebar_hook_type = RevitRebarHookType()
normal_17 = Curve.Normal(byJoinedCurves)
byCurve_17 = Rebar.ByCurve(byJoinedCurves, id, rebar_style_7, rebar_bar_type, rebar_hook_orientation, rebar_hook_orientation, rebar_hook_type, rebar_hook_type, normal_17)
select_model_element_4 = DSModelElementSelection()
create_18 = List.Create(windowPoint0, windowPoint3)
firstItem = List.FirstItem(create_18)
lastItem = List.LastItem(create_18)
byStartPointEndPoint_2 = Line.ByStartPointEndPoint(startPoint=firstItem, endPoint=lastItem)
boolean_2 = BoolSelector(false)
rebar_bar_type_2 = RebarBarType("10 A1000")
rebar_hook_type_2 = RevitRebarHookType("Стандартный - 135 градусов")
string = StringInput("05 прямой в стиле хомута")
byName = Custom[RebarShape.ByName](RebarShapeName=string)  # Get the Rebar Shape object from Revit, based on the given name.
code_block = CodeBlock { 150.5; }
code_block_2 = CodeBlock { 200.2; }
createByCurveAndShapeCode = Custom[PathReinforcement.CreateByCurveAndShapeCode](HostElement=select_model_element_4, PathCurves=byStartPointEndPoint_2, Flip=boolean_2, BarType=rebar_bar_type_2, RebarStartHookType=rebar_hook_type_2, RebarEndHookType=rebar_hook_type_2, RebarShape=byName, BarLength=code_block, BarSpacing=code_block_2)  # Create a path reinforcement based on a list of curves and a predefined Rebar Shape Code.
normal_18 = Curve.Normal(byStartPointEndPoint_2)
create_19 = List.Create(byStartPointEndPoint_2)
rebar_hook_orientation_2 = RebarHookOrientation("Left")
createFromCurvesAndShape = Rebar.Methods.CreateFromCurvesAndShape(byName, rebar_bar_type_2, rebar_hook_type_2, rebar_hook_type_2, select_model_element_4, normal_18, create_19, rebar_hook_orientation_2, rebar_hook_orientation_2)
byStartPointEndPoint_3 = Line.ByStartPointEndPoint(startPoint=wallPoint15, endPoint=minPoint)
length = Curve.Length(byStartPointEndPoint_3)
code_block_3 = CodeBlock(x=length) { x/2; }
pointAtSegmentLength = Curve.PointAtSegmentLength(curve=byStartPointEndPoint_3, segmentLength=code_block_3)
byStartPointEndPoint_4 = Line.ByStartPointEndPoint(startPoint=wallPoint8, endPoint=minPoint)
length_2 = Curve.Length(byStartPointEndPoint_4)
code_block_4 = CodeBlock(x=length_2) { x/2; }
pointAtSegmentLength_2 = Curve.PointAtSegmentLength(curve=byStartPointEndPoint_4, segmentLength=code_block_4)
byStartPointEndPoint_5 = Line.ByStartPointEndPoint(startPoint=pointAtSegmentLength, endPoint=pointAtSegmentLength_2)
select_model_element_5 = DSModelElementSelection()
id_2 = Element.Id(select_model_element_5)
rebar_style_8 = RebarStyle("Standard")
rebar_bar_type_3 = RebarBarType("10 A1000")
rebar_hook_orientation_3 = RebarHookOrientation("Right")
rebar_hook_type_3 = RevitRebarHookType("Отгиб арматуры 90")
normal_19 = Curve.Normal(byStartPointEndPoint_5)
byCurve_18 = Rebar.ByCurve(byStartPointEndPoint_5, id_2, rebar_style_8, rebar_bar_type_3, rebar_hook_orientation_3, rebar_hook_orientation_3, rebar_hook_type_3, rebar_hook_type_3, normal_19)
parameters = Element.Parameters(byCurve_18)
byStartPointEndPoint_6 = Line.ByStartPointEndPoint()  # unwired: startPoint, endPoint
length_3 = Curve.Length(byStartPointEndPoint_6)
code_block_5 = CodeBlock(x=length_3) { x/2; }
pointAtSegmentLength_3 = Curve.PointAtSegmentLength(curve=byStartPointEndPoint_6, segmentLength=code_block_5)
byStartPointEndPoint_7 = Line.ByStartPointEndPoint()  # unwired: startPoint, endPoint
length_4 = Curve.Length(byStartPointEndPoint_7)
code_block_6 = CodeBlock(x=length_4) { x/2; }
pointAtSegmentLength_4 = Curve.PointAtSegmentLength(curve=byStartPointEndPoint_7, segmentLength=code_block_6)
byStartPointEndPoint_8 = Line.ByStartPointEndPoint(startPoint=pointAtSegmentLength_3, endPoint=pointAtSegmentLength_4)
select_model_element_6 = DSModelElementSelection()
id_3 = Element.Id(select_model_element_6)
rebar_style_9 = RebarStyle("Standard")
rebar_bar_type_4 = RebarBarType("10 A1000")
rebar_hook_orientation_4 = RebarHookOrientation("Right")
rebar_hook_type_4 = RevitRebarHookType("Отгиб арматуры 90")
normal_20 = Curve.Normal(byStartPointEndPoint_8)
byCurve_19 = Rebar.ByCurve(byStartPointEndPoint_8, id_3, rebar_style_9, rebar_bar_type_4, rebar_hook_orientation_4, rebar_hook_orientation_4, rebar_hook_type_4, rebar_hook_type_4, normal_20)
parameters_2 = Element.Parameters(byCurve_19)
