# Dynamo graph insets.dyn (Dynamo 1.3.2.2480)

perimeterCurves = Surface.PerimeterCurves()  # unwired: arg0
flatten = Flatten(perimeterCurves)
number = DoubleInput(0)
number_2 = DoubleInput(8)
number_3 = DoubleInput(1)
sequence = Sequence(start=number, amount=number_2, step=number_3, lacing=Longest)
getItemAtIndex = List.GetItemAtIndex(list=flatten, index=sequence)
normal = Curve.Normal(getItemAtIndex)
select_face = DSFaceSelection()  # 1 picked in the model
vertices = Face.Vertices(select_face)
pointGeometry = Vertex.PointGeometry(vertices)
flatten_2 = Flatten(pointGeometry)
number_4 = DoubleInput(0)
number_5 = DoubleInput(4)
number_6 = DoubleInput(2)
sequence_2 = Sequence(start=number_4, amount=number_5, step=number_6, lacing=Longest)
startpoint = List.GetItemAtIndex(list=flatten_2, index=sequence_2)
number_7 = DoubleInput(1)
number_8 = DoubleInput(4)
number_9 = DoubleInput(2)
sequence_3 = Sequence(start=number_7, amount=number_8, step=number_9, lacing=Longest)
endpoint = List.GetItemAtIndex(list=flatten_2, index=sequence_3)
byStartPointEndPoint = Line.ByStartPointEndPoint(startPoint=startpoint, endPoint=endpoint)
select_model_element = DSModelElementSelection()  # 1 picked in the model
getHost = FamilyInstance.GetHost(select_model_element)
id = Element.Id(getHost)
rebar_style = RebarStyle("Standard")
rebar_bar_type = RebarBarType("12 A500 (сборка)")
rebar_hook_orientation = RebarHookOrientation("Left")
rebar_hook_orientation_2 = RebarHookOrientation("Right")
rebar_hook_type = RevitRebarHookType("None")
rebar_hook_type_2 = RevitRebarHookType("None")
byCurve = Rebar.ByCurve(byStartPointEndPoint, id, rebar_style, rebar_bar_type, rebar_hook_orientation, rebar_hook_orientation_2, rebar_hook_type, rebar_hook_type_2, lacing=Longest)  # unwired: arg8
startPoint = Curve.StartPoint(perimeterCurves)
endPoint = Curve.EndPoint(perimeterCurves)
byBlendBetweenCurves = Curve.ByBlendBetweenCurves()  # unwired: arg0, arg1
getHost_2 = FamilyInstance.GetHost()  # unwired: arg0
select_walls_and_or_floors = DSModelElementsSelection()  # 2 picked in the model
normal_2 = Curve.Normal(byStartPointEndPoint)
boolean = BoolSelector(false)
createDefault = PathReinforcement.PathReinforcementType.CreateDefault()
rebar_bar_type_2 = RebarBarType("10 A1000")
rebar_hook_type_3 = RevitRebarHookType("None")
create = PathReinforcement.Methods.Create(select_walls_and_or_floors, normal_2, boolean, createDefault, rebar_bar_type_2, rebar_hook_type_3, rebar_hook_type_3)
