# Dynamo graph windowOnly.dyn (Dynamo 1.3.2.2480)

select_model_element = DSModelElementSelection()  # 1 picked in the model
select_model_elements = DSModelElementsSelection()  # 2 picked in the model
getParts = Custom[Element.GetParts](List=select_model_elements)  # Get parts for the elements from Input. Returns Parts and Parent elements
boundingBox = Geometry.BoundingBox(getParts.Parents)
minPoint = BoundingBox.MinPoint(boundingBox)
maxPoint = BoundingBox.MaxPoint(boundingBox)
byCorners = Cuboid.ByCorners(lowPoint=minPoint, highPoint=maxPoint)
width = Cuboid.Width(byCorners)
height = Cuboid.Height(byCorners)
byTwoPoints = Vector.ByTwoPoints(start=maxPoint, end=minPoint)
byStartPointEndPoint = Line.ByStartPointEndPoint(startPoint=maxPoint, endPoint=minPoint)
selectWall = DSModelElementSelection()  # 1 picked in the model
id = Element.Id(selectWall)
rebar_style = RebarStyle("Standard")
rebar_bar_type = RebarBarType("10 A1000")
rebar_hook_orientation = RebarHookOrientation("Left")
rebar_hook_type = RevitRebarHookType("None")
select_face = DSFaceSelection()  # 1 picked in the model
number = DoubleInput(8)
boolean = BoolSelector(false)
number_2 = DoubleInput(0)
boolean_2 = BoolSelector(true)
boolean_3 = BoolSelector(true)
followingSurface = DynamoRebar.Rebar.FollowingSurface(select_face, number, arg3=boolean, arg4=number_2, arg5=boolean_2, arg6=boolean_3)
normal = Curve.Normal(followingSurface)
byCurve = Rebar.ByCurve(arg1=id, arg2=rebar_style, arg3=rebar_bar_type, arg4=rebar_hook_orientation, arg5=rebar_hook_orientation, arg6=rebar_hook_type, arg7=rebar_hook_type, arg8=normal)  # unwired: arg0
create = RebarContainer.Methods.Create(id)  # unwired: arg1
byStartPointEndPoint_2 = Line.ByStartPointEndPoint(startPoint=minPoint, endPoint=maxPoint)
addIntersect = Custom[DividedSurface.AddIntersect]()  # Adds an intersect to a divided surface; unwired: dividedSurface, element
number_3 = DoubleInput(3)
select_face_2 = DSFaceSelection()  # 1 picked in the model
divideSurfaceUV = Geometry.Surfaces.DivideSurfaceUV(select_face_2)  # unwired: arg1, arg2
makeParts = Custom[Element.MakeParts](Elements=select_model_elements)  # Create Parts from valid elements
